# Grasshopper definition WaveFunctionCollapse.gh (Grasshopper 1.0.4)
# plug-ins: WaveFunctionCollapse

panel = Panel("TILE 01")
half_tile = Surface(graft([<surface referenced from the Rhino model> x7]))
box_corners = BoxCorners(Box=half_tile)  # -> CornerA, CornerB, CornerC, CornerD, CornerE, CornerF, CornerG, CornerH
average = Average(Input=[box_corners.CornerB, box_corners.CornerA, box_corners.CornerC, box_corners.CornerD])  # -> flatten(ArithmeticMean)

panel_2 = Panel("TILE 02")
full_tile = Surface(graft([<surface referenced from the Rhino model> x5]))
box_corners_2 = BoxCorners(Box=full_tile)  # -> CornerA, CornerB, CornerC, CornerD, CornerE, CornerF, CornerG, CornerH
average_2 = Average(Input=[box_corners_2.CornerC, box_corners_2.CornerA, box_corners_2.CornerB, box_corners_2.CornerD])  # -> flatten(ArithmeticMean)

tiles_area = Surface(<surface referenced from the Rhino model>)
panel_3 = Panel("Sample Tile Size")
dimensions = Dimensions(Surface=tiles_area)  # -> UDimension, VDimension
divide_surface = DivideSurface(Surface=tiles_area, UCount=dimensions.UDimension, VCount=dimensions.VDimension)  # -> flatten(Points), Normals, Parameters
c_script = CSharpScript(PointsX=divide_surface.Points)  # -> out, flatten(A), B; inputs PointsX: list of Point3d
# ---------- c_script: C# ----------
    var res = new List<Point3d>();

    for (int i = 0; i < PointsX.Count; i++)
    {

      if (Convert.ToInt32(PointsX[i].X) % 2 != 0 && Convert.ToInt32(PointsX[i].Y) % 2 != 0)
      {
        res.Add(PointsX[i]);
      }

    }

    A = res;

    B = PointsX.Count;
# ---------- end c_script ----------

# ---- group: COLOURS
second_tile_colour = ColourSwatch(SwatchColor=RGB(105, 191, 174))
empty_tile_colour = ColourSwatch(SwatchColor=RGB(232, 232, 232))
first_tile_colour = ColourSwatch(SwatchColor=RGB(75, 163, 204))

# ---- group: WAVE
tiles_area_2 = Surface(<surface referenced from the Rhino model>)
dimensions_2 = Dimensions(Surface=tiles_area_2)  # -> UDimension, VDimension
divide_surface_2 = DivideSurface(Surface=tiles_area_2, UCount=dimensions_2.UDimension, VCount=dimensions_2.VDimension)  # -> flatten(Points), Normals, Parameters
c_script_2 = CSharpScript(PointsX=divide_surface_2.Points)  # -> out, flatten(A), B; inputs PointsX: list of Point3d; same code as c_script
c_script_3 = CSharpScript(PointsX=divide_surface_2.Points)  # -> out, flatten(A), B; inputs PointsX: list of Point3d
# ---------- c_script_3: C# ----------
    var res = new List<Point3d>();

    for (int i = 0; i < PointsX.Count; i++)
    {

      if (Convert.ToInt32(PointsX[i].X) % 2 == 0 && Convert.ToInt32(PointsX[i].Y) % 2 == 0)
      {
        res.Add(PointsX[i]);
      }

    }

    A = res;

    B = PointsX.Count;
# ---------- end c_script_3 ----------

# ----
custom_preview = CustomPreview(Geometry=half_tile, Material=first_tile_colour)
custom_preview_2 = CustomPreview(Geometry=tiles_area, Material=empty_tile_colour)
custom_preview_3 = CustomPreview(Geometry=full_tile, Material=second_tile_colour)
c_script_4 = CSharpScript(x=average, y=average_2, z=c_script.A)  # -> out, A; inputs x: list of Point3d, y: list of Point3d, z: list of Point3d
# ---------- c_script_4: C# ----------
    int[] weights = new int[3];

    weights[0] = x.Count;
    weights[1] = y.Count;
    weights[2] = z.Count - x.Count - y.Count;

    A = weights;
# ---------- end c_script_4 ----------
boolean_toggle = BooleanToggle(True)
patterns_testtt = Patterns_testtt(
    TileTypeA=average,
    TileTypeB=average_2,
    WholeTilePoints=c_script.A,
    TileSize=Slider(2, range=0..10),
    RotateTiles=Toggle(True))  # -> PatternFromSampleParameter, HalfTiles, FullTiles, EmptyTiles
number_slider = Slider(9, range=0..10)
number_slider_2 = Slider(43, range=0..100)
number_slider_3 = Slider(23, range=0..30)
observe_and_collapse = ObserveAndCollapse(PatternFromSampleParameter=patterns_testtt.PatternFromSampleParameter, Wave=c_script_3.A, Backtrack=boolean_toggle)  # -> NumberOfRotatedTiles, PatternHistoryParameter, PatternCount, AverageContradictionValue
wfcx = WFCx(
    PatternFromSampleParameter=patterns_testtt.PatternFromSampleParameter,
    Wave=c_script_3.A,
    DatasetSize="19000",
    Backtrack=boolean_toggle)  # disabled
surface = Surface(<surface referenced from the Rhino model>)

# ---- group: PATTERN FROM SAMPLE: HALF TILE
c_script_5 = CSharpScript(Surface=surface, Vector=patterns_testtt.HalfTiles)  # -> out, A; inputs Surface: Surface, Vector: Vector3d
# ---------- c_script_5: C# ----------
    var copy = Surface.Duplicate();
    copy.Translate(Vector);

    A = copy;
# ---------- end c_script_5 ----------
custom_preview_4 = CustomPreview(Geometry=c_script_5.A, Material=first_tile_colour)

# ---- group: PATTERN FROM SAMPLE: FULL TILE
c_script_6 = CSharpScript(Surface=surface, Vector=patterns_testtt.FullTiles)  # -> out, A; inputs Surface: Surface, Vector: Vector3d; same code as c_script_5
custom_preview_5 = CustomPreview(Geometry=c_script_6.A, Material=second_tile_colour)

# ---- group: PATTERN FROM SAMPLE: NULL TILES
c_script_7 = CSharpScript(Surface=surface, Vector=patterns_testtt.EmptyTiles)  # -> out, A; inputs Surface: Surface, Vector: Vector3d; same code as c_script_5
custom_preview_6 = CustomPreview(Geometry=c_script_7.A, Material=empty_tile_colour)

# ---- group: RANDOM SURFACE
randompattern = RandomPattern(
    Wave=c_script_3.A,
    TILE01=surface,
    TILE02=surface,
    EMPTY=surface,
    XWAVELOCATION=Slider(-40, range=-110..50),
    YWAVELOCATION=Slider(41, range=-50..80),
    Weights=c_script_4.A)  # -> WaveHalfSurfaces, WaveFullSurfaces, WaveEmptySurfaces
custom_preview_7 = CustomPreview(Geometry=randompattern.WaveHalfSurfaces, Material=first_tile_colour)
custom_preview_8 = CustomPreview(Geometry=randompattern.WaveEmptySurfaces, Material=empty_tile_colour)
custom_preview_9 = CustomPreview(Geometry=randompattern.WaveFullSurfaces, Material=second_tile_colour)

# ----
panel_4 = Panel(observe_and_collapse.PatternHistoryParameter)
visualise_by_history = VisualiseByHistory(
    WaveFunctionCollapsed=observe_and_collapse.PatternHistoryParameter,
    Timelapse=Slider(1, range=0..1),
    TILE01=surface,
    TILE02=surface,
    TILE03=surface,
    XWAVELOCATION=number_slider_3,
    YWAVELOCATION=number_slider_2,
    Tile01Colour=first_tile_colour,
    Tile02Colour=second_tile_colour,
    TileEmpty=empty_tile_colour)  # -> WaveHalfSurfaces, WaveFullSurfaces, WaveEmptySurfaces, Colours, Uncollapsed, PatternCount
export_wfc = ExportWfc(WaveFunctionDataset=wfcx, PatternFromSample=patterns_testtt.PatternFromSampleParameter)
panel_5 = Panel(wfcx)
custom_preview_10 = CustomPreview(Geometry=visualise_by_history.Uncollapsed, Material=visualise_by_history.Colours)
custom_preview_11 = CustomPreview(Geometry=visualise_by_history.WaveFullSurfaces, Material=second_tile_colour)
custom_preview_12 = CustomPreview(Geometry=visualise_by_history.WaveFullSurfaces, Material=second_tile_colour)
custom_preview_13 = CustomPreview(Geometry=visualise_by_history.WaveHalfSurfaces, Material=first_tile_colour)
addition = Addition(A=number_slider_3, B=Slider(65, range=0..100))
evaluateproportions = EvaluateProportions(
    WaveHalfSurfaces=visualise_by_history.WaveHalfSurfaces,
    WaveFullSurfaces=visualise_by_history.WaveFullSurfaces,
    WaveEmptySurfaces=visualise_by_history.WaveEmptySurfaces,
    X=addition,
    Y=number_slider_2)  # -> port, port_2, port_3, port_4, port_5, port_6
custom_preview_14 = CustomPreview(Geometry=evaluateproportions.port, Material=first_tile_colour)
custom_preview_15 = CustomPreview(Geometry=evaluateproportions.port_2, Material=second_tile_colour)
custom_preview_16 = CustomPreview(Geometry=evaluateproportions.port_3, Material=empty_tile_colour)

# ---- group: VISUALISE LINE
list_length = ListLength(List=visualise_by_history.PatternCount)
addition_2 = Addition(A=visualise_by_history.PatternCount, B=Slider(14, range=0..80))
series = Series(Start=Slider(21, range=0..100), Step=Slider(12.03, range=0..20), Count=list_length)

# ----
division = Division(A=addition_2, B=Slider(1, range=0..9))

# ---- group: VISUALISE LINE (continued)
construct_point = ConstructPoint(XCoordinate=series, YCoordinate=division, ZCoordinate=0)
interpolate = Interpolate(Vertices=construct_point, Degree=Slider(1, range=0..10), Periodic=False, KnotStyle=1)  # -> Curve, Length, Domain

# ----
custom_preview_17 = CustomPreview(Geometry=interpolate.Curve, Material=ColourSwatch(SwatchColor=RGB(219, 0, 0)))
