# Grasshopper definition WaveFunctionCollapse_test.gh (Grasshopper 1.0.4)
# plug-ins: WaveFunctionCollapse

half_tile = Surface(graft([<surface referenced from the Rhino model> x3]))
box_corners = BoxCorners(Box=half_tile)  # -> CornerA, CornerB, CornerC, CornerD, CornerE, CornerF, CornerG, CornerH
avr = Average(Input=[box_corners.CornerB, box_corners.CornerA, box_corners.CornerC, box_corners.CornerD])  # -> flatten(ArithmeticMean)
panel = Panel(avr)

full_tile = Surface(graft([<surface referenced from the Rhino model> x4]))
box_corners_2 = BoxCorners(Box=full_tile)  # -> CornerA, CornerB, CornerC, CornerD, CornerE, CornerF, CornerG, CornerH
avr_2 = Average(Input=[box_corners_2.CornerC, box_corners_2.CornerA, box_corners_2.CornerB, box_corners_2.CornerD])  # -> flatten(ArithmeticMean)
panel_2 = Panel(avr_2)

tiles_area = Surface(<surface referenced from the Rhino model>)
dim = Dimensions(Surface=tiles_area)  # -> UDimension, VDimension
sdivide = DivideSurface(Surface=tiles_area, UCount=dim.UDimension, VCount=dim.VDimension)  # -> Points, Normals, Parameters
c_script = CSharpScript(x=sdivide.Points)  # -> out, flatten(A); inputs x: list of Point3d
# ---------- c_script: C# ----------
    List<Point3d> resp = new List<Point3d>();
    
    for (int i = 0; i < x.Count; i++)
    {
      if (x[i].X % 2 != 0 && x[i].Y % 2 != 0)
      {
        resp.Add(x[i]);
      }

      A = resp;
    }
# ---------- end c_script ----------

panel_3 = Panel(c_script.A)
wfc_bla = WaveFunctionCollapse(TileTypeA=avr, TileTypeB=avr_2, WholeTilePoints=c_script.A)  # -> NullsInTileset, States
points = PointList(Points=wfc_bla.NullsInTileset)
panel_4 = Panel(wfc_bla.States)
